# Grasshopper definition assignment_02.gh (Grasshopper 1.0.7)

# ---- group: set config
# Configuration
a1 = Slider(36, range=-360..360)  # disabled
a2 = Slider(-90, range=-360..360)  # disabled
a4 = Slider(-90, range=-360..360)  # disabled
a5 = Slider(-90, range=-360..360)  # disabled
a3 = Slider(90, range=-360..360)  # disabled
a6 = Slider(0, range=-360..360)  # disabled
config = PythonScript(vals=[a1, a2, a3, a4, a5, a6])  # -> config; inputs vals: list; disabled
# ---------- config: Python ----------
import math
from compas.robots import Configuration

config = Configuration.from_revolute_values([math.radians(a) for a in vals])
# ---------- end config ----------

# ----
python = GhPythonScript(vals=[Slider(19, range=0..180), Slider(32, range=0..180), Slider(31, range=0..180), Slider(0, range=0..180), Slider(59, range=0..180)])  # -> out, a, model; inputs vals: list
# ---------- python: Python ----------
"""Assignment 02: Build your own robot model
"""
import math
from compas.artists import Artist
from compas.datastructures import Mesh
from compas.geometry import Circle
from compas.geometry import Cylinder, Sphere, Box
from compas.geometry import Frame
from compas.geometry import Plane
from compas.geometry import Translation
from compas.geometry import Rotation
from compas.robots import Configuration
from compas.robots import Joint
from compas.robots import RobotModel

# create cylinder in yz plane
radius, length, edge, chubby_rad, chubby_len = 0.3, 5, 0.4, 0.6 ,1.2
cylinder = Cylinder(Circle(Plane([0, 0, 0], [1, 0, 0]), radius), length)
cylinder.transform(Translation.from_vector([length / 2.0, 0, 0]))
chubby = Cylinder(Circle(Plane([0,0,0],[0,0,1]), chubby_rad), chubby_len)
sphere = Sphere([0,0,0],radius*2)
box = Box(Frame.worldXY(), length, edge, edge)
# create robot model
model = RobotModel("robot", links=[], joints=[])

# link meshes (calling Mesh.from_shape effectively creates a copy of the shape)
mesh1 = Mesh.from_shape(cylinder)
mesh2 = Mesh.from_shape(cylinder)
mesh3 = Mesh.from_shape(sphere)
mesh4 = Mesh.from_shape(box)
mesh5 = Mesh.from_shape(chubby)

# add links
link0 = model.add_link("world")
link1 = model.add_link("link1", visual_mesh=mesh1, visual_color=(0.2, 0.5, 0.6))
link2 = model.add_link("link2", visual_mesh=mesh2, visual_color=(0.5, 0.6, 0.2))
link3 = model.add_link("link3", visual_mesh=mesh3, visual_color=(0.1,0.3,0.6))
link4 = model.add_link("link4", visual_mesh=mesh4, visual_color=(0.8, 0.1,0.2))
link5 = model.add_link("link5", visual_mesh = mesh5, visual_color = (0.1, 0.1, 0.9))
# add joints between the links
axis = (0, 0, 1)
axisy = (0,1,1)
origin = Frame.worldXY()
model.add_joint("joint1", Joint.CONTINUOUS, link0, link1, origin, axis)

origin = Frame((length, 0, 0), (1, 0, 0), (0, 1, 0))
model.add_joint("joint2", Joint.CONTINUOUS, link1, link2, origin, axis)

origin = Frame((length+radius, 0, 0),(1,0,0),(0,1,0))
model.add_joint("joint3", Joint.CONTINUOUS, link2, link3, origin, axis)

origin = Frame((length/2,0,0),(1,0,0),(0,1,0))
model.add_joint("joint4", Joint.CONTINUOUS, link3, link4, origin,axis)

origin = Frame((length/2+(2*chubby_rad/3),0,0),(1,0,0),(0,1,0))
model.add_joint("joint5", Joint.CONTINUOUS, link4, link5, origin, axisy)

# Create a configuration object matching the number of joints in your model

configuration = model.zero_configuration()

#configuration = Configuration.from_revolute_values([math.radians(a) for a in vals])
print(configuration)

configuration.joint_values = [math.radians(a) for a in vals]
print(configuration.joint_values)
#configuration.joint_values = vals
# Update the model using the artist
artist = Artist(model)
artist.update(configuration)

# Render everything
a = artist.draw_visual()
#a = artist.redraw()
# ---------- end python ----------

# ----
# Visualisation
visualize = GhPythonScript(model=python.model, artist=python.a, config=config)  # -> out, a; disabled
# ---------- visualize: Python ----------
new_config = model.zero_configuration()
new_config.joint_values = config.joint_values
artist.update(new_config)
a = artist.draw_visual()
# ---------- end visualize ----------

python_2 = GhPythonScript()  # -> out, artist; disabled
# ---------- python_2: Python ----------
from compas.robots import GithubPackageMeshLoader
from compas.robots import RobotModel
from compas.artists import Artist

# Select Github repository, package and branch where the model is stored
r = "ros-industrial/abb"
p = "abb_irb6600_support"
b = "kinetic-devel"

github = GithubPackageMeshLoader(r, p, b)
urdf = github.load_urdf("irb6640.urdf")

# Create robot model from URDF
model = RobotModel.from_urdf_file(urdf)
artist = Artist(model)
artist.draw_visual()
artist.redraw
print(model)
# ---------- end python_2 ----------
